# Grasshopper definition AdvancedMkDocs.gh (Grasshopper 1.0.8)
# plug-ins: DocsHopper

panel = Panel("This is a section test. The following figure is a Grasshopper definition:")
path = FilePath()
hsection = CreateHomepageSection(SectionTitle="This is a section", ContentText=panel, ImageFilepath=path)
custommkdocs = CustomMKDocs(
    ThemeScheme="slate",
    PrimaryColor="purple",
    AccentColor="red",
    RepoURL="https://github.com/gvegasol/Syntactics",
    SiteAuthor="Gonzalo Vegas")
path_2 = FilePath("C:\Users\makel\Desktop\ghdocs\syntactics_fullcustom_01\")
advexportmkdocs = ExportAdvancedMkDocsSite(
    PluginName="Syntactics",
    MainDescription="This is the Syntactics plugin documentation.",
    OutputDirectory=path_2,
    CustomConfig=custommkdocs,
    HomepageSections=hsection,
    RunExport=Toggle(False))  # -> MkDocsFolder, Status
panel_2 = Panel(advexportmkdocs.MkDocsFolder)
panel_3 = Panel(advexportmkdocs.Status)
previewdocs = PreviewMkDocs(MkDocsFolder=advexportmkdocs.MkDocsFolder, LaunchServer=Toggle(False), InstallMkDocs=False)
panel_4 = Panel(previewdocs)
