# Grasshopper definition CustomCSS.gh (Grasshopper 1.0.8)
# plug-ins: DocsHopper

swatch = ColourSwatch(SwatchColor=RGB(0, 0, 0))
customcss = CustomCSS(
    PrimaryColor=swatch,
    BackgroundColor=ColourSwatch(SwatchColor=RGB(255, 255, 255)),
    TextColor=swatch,
    BorderColor=ColourSwatch(SwatchColor=RGB(120, 120, 120)),
    FontFamily="'Segoe UI', system-ui, sans-serif",
    MaxWidth=900)
path = FilePath()
exporthtml_css = ExportHTMLCSS(
    PluginName="Syntactics",
    MainDescription="Syntactics documentation.",
    OutputDirectory=path,
    CustomCSS=customcss,
    RunExport=Toggle(False))  # -> HTMLCSSFolder, Status
panel = Panel(exporthtml_css.Status)
previewhtml = PreviewHTML(HTMLDirectory=exporthtml_css.HTMLCSSFolder, RunPreview=Toggle(True))
panel_2 = Panel(previewhtml)
