# Grasshopper definition MkDocs.gh (Grasshopper 1.0.8)
# plug-ins: DocsHopper

panel = Panel("This is the Eddy3D-Outdoor+ plugin documentation. Amazing plugin.")
path = FilePath()
exportmkdocs = ExportMkDocsSite(PluginName="Eddy3D-Outdoor+", MainDescription=panel, OutputDirectory=path, RunExport=Toggle(False))  # -> MkDocsFolder, Status
panel_2 = Panel(exportmkdocs.MkDocsFolder)
panel_3 = Panel(exportmkdocs.Status)
previewdocs = PreviewMkDocs(MkDocsFolder=exportmkdocs.MkDocsFolder, LaunchServer=Toggle(False), InstallMkDocs=Toggle(False))
